# Dynamo graph Paraboloide_Midi.dyn (Dynamo 2.17.1.4055)

zero = TimeSpan.Zero()
now = DateTime.Now()
timeOfDay = DateTime.TimeOfDay(dateTime=now)
add = TimeSpan.Add(timeSpan1=zero, timeSpan2=timeOfDay)
constroi_a_matriz_plana = CodeBlock(tempo=add)
# ---------- constroi_a_matriz_plana.designscript (15 lines) ----------
tempo;
//---------------------------------------------------
// Converte em string o Tempo Atual e separa miliseg.
//---------------------------------------------------
max  = 16;
mx   = max/2;
mili = String.Substring ( tempo+"" , 9 , 4);
s    = (String.ToNumber ( mili ) % max )+ 1;
x    = (-mx..mx)* s * Math.Random(s/2);
y    = (-mx..mx)* s * Math.Random(s/2);
pt   = Point.ByCoordinates ( x<1> , y);
z1   = (0..max) * s * Math.Random(s);
z2   = (max..0) * s;
p1   = pt[ 0].Translate ( 0 , 0 , z1);
p2   = pt[-1].Translate ( 0 , 0 , z2);
# ----------------------------------------
code_block = CodeBlock { 0; }
MIDI_Ativar = Musica_2020.Musica_2020.MIDI_Ativar(n=code_block)
revit_uia = Python()  # CPython3
# ---------- revit_uia.python (20 lines) ----------
import clr
import Revit

clr.AddReference("ProtoGeometry")
clr.AddReference("RevitAPI")
clr.AddReference("RevitAPIUI")
clr.AddReference("RevitServices")
clr.AddReference("RevitNodes")

from Autodesk.DesignScript.Geometry import *
from Autodesk.Revit.DB import *
from RevitServices.Persistence import DocumentManager


#dad = IN[0]

doc = DocumentManager.Instance.CurrentDBDocument
uia = DocumentManager.Instance.CurrentUIApplication

OUT = uia
# ----------------------------------------
tocar = CodeBlock(max=constroi_a_matriz_plana.max, s=constroi_a_matriz_plana.s, p1=constroi_a_matriz_plana.p1, p2=constroi_a_matriz_plana.p2, midi=MIDI_Ativar, app=revit_uia)
# ---------- tocar.designscript (48 lines) ----------
max;
s;
p1;
p2;
midi;
app;

gx    = Line.ByStartPointEndPoint ( p1    ,   p2   );
gy    = Line.ByStartPointEndPoint ( px[0] , px[-1] );
px    = Line.PointAtParameter     ( gx<1> , 0..1..#max+1);
py    = List.Transpose ( px );
co1   = List.Flatten( Math.Floor ( px.Z     ), 1);
co2   = List.Flatten( Math.Floor ( py.Z     ), 1);
//-------------------------------------------------------------------------
// Listas iniciais de escalas e duração
//-------------------------------------------------------------------------
andam = 11000;
bra   = andam / max;
esc   = [   0,  -2,   3,   7,   5,  -9 ];
tem   = [ 1/2, 1/4, 1/4, 1/4, 1/2, 1/4 ];
mo1   = esc + s%3;
mo2   = 12  - (List.Reverse( mo1 ) * -1);
dur   = tem * bra;
//-------------------------------------------------------------------------
// Se aumentar dur, aumentar o período para completar ciclo
//-------------------------------------------------------------------------
me    = List.Count ( esc )-1;
md    = List.Count ( dur )-1;
i     = co1 % me;
j     = co2 % me;
k     = co1 % md;

f0    = 52 + s%3;
s1    = List.ShiftIndices( mo1 , 1 )[i];
s2    = List.ShiftIndices( mo2 , 1 )[j];
du    = List.ShiftIndices( dur , 1 )[k];
v1    =  11;
v2    =  99;
v3    =  98;
fd    =  30;
//-------------------------------------------------------------------------
qp    = List.Count( s1 );
az    = 0..405..#qp;
al    = 0.. 90..#qp;
//-------------------------------------------------------------------------
// Tocar
//-------------------------------------------------------------------------
Musica_2020.Tocar_Vozes(app, midi, f0, s1, s2, du, v1, v2, v3, fd, az, al);
# ----------------------------------------
watch = Watch(tocar.i)
